# Grasshopper definition Boxes-to-lines.gh (Grasshopper 1.0.7)
# plug-ins: Human, horsterCameraControl, Pufferfish

geo = Geometry([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])
geo_2 = Geometry([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])
geo_3 = Geometry([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])
geo_4 = Geometry([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])
geo_5 = Geometry([<brep referenced from the Rhino model> x4])
geo_6 = Geometry([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])
geo_7 = Geometry([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])
geo_8 = Geometry(geo_7)
z_tolerance = Slider(0.5, range=-0.5..0.5)
actuator = Slider(0, range=0..50)
number_slider = Slider(41, range=0..100)
panel = Panel("""0.8
0.8
0.8""")
list = ValueList({"Basic Full": 0, "First Floor only": 1, "Bench": 2, "Low Bench": 3}, selected="Basic Full")
list_2 = ValueList({"Slider": 0, "Type": 1}, selected="Slider")
filter = StreamFilter(Gate=list_2, Stream0=[Slider(0.5, range=0.5..1), Slider(0.8, range=0.5..1), Slider(0.8, range=0.5..1)], Stream1=panel)

box = Box({Plane=PlaneXY(14, 1, 0), X=Domain(0, 3.5), Y=Domain(0, 2.5), Z=Domain(0, 2)})
number_slider_2 = Slider(4.2, range=1..10)
number_slider_3 = Slider(7.4, range=1..10)
bbox = BoundingBox(Content=box, Plane=PlaneXY(0, 0, 0), UnionBox=True)  # -> Box, Box_2
number_slider_4 = Slider(1.6, range=1..10)
volume = Volume(Geometry=bbox.Box)  # -> Volume, Centroid
volume_2 = Volume(Geometry=bbox.Box)  # -> Volume, Centroid
cp = ClosestPoint(Point=volume_2.Centroid, Cloud=volume.Centroid)  # -> ClosestPoint, CPIndex, Distance
vec = VectorXYZ(XComponent=expr("-x", "11.8"), YComponent=expr("-x", "-3.74"), ZComponent="2.574")  # -> Vector, Length
move = Move(Geometry=cp.ClosestPoint, Motion=vec.Vector)  # -> Geometry, Transform
num = Number("35")
setcam = SetCamera(CameraLocation=move.Geometry, TargetLocation=cp.ClosestPoint, LensLength=num, Activate=Toggle(False))

item = ListItem(List=filter, Index=0, Wrap=True)  # -> Item, Item1, Item2
box_2 = DomainBox(Base=PlaneXY(14, 1, -2.41180409e-11), X=item.Item, Y=item.Item1, Z=item.Item2)
addition = Addition(A="2", B=z_tolerance)
division = Division(A=addition, B=item.Item2)
division_2 = Division(A="2.5", B=item.Item1)
division_3 = Division(A="3.5", B=item.Item)
round = Round(Number=division_3)  # -> Nearest, Floor, Ceiling
round_2 = Round(Number=division)  # -> Nearest, Floor, Ceiling
round_3 = Round(Number=division_2)  # -> Nearest, Floor, Ceiling
case = Slider(2, range=0..100)  # disabled

box_3 = DomainBox(Base=PlaneXY(15.5, 2.5, 0), X=Domain(-1.5, 1.5), Y=Domain(-1.5, 1.5), Z=Domain(0, 2))  # disabled
geo_9 = Geometry([<brep referenced from the Rhino model> x2393])  # disabled
rectangle = Rectangle(Plane=box_3, XSize=Domain(0, 9), YSize=Domain(0, 9), Radius=0)  # -> Rectangle, Length; disabled
panel_2 = Panel("15")  # disabled
panel_3 = Panel("24")  # disabled
arrrec = RectangularArray(Geometry=box_3, Cell=rectangle.Rectangle, XCount=panel_3, YCount=panel_2)  # -> Geometry, Transform; disabled
volume_3 = Volume(Geometry=geo_9)  # -> Volume, Centroid; disabled
brepsinc = PointInBreps(Brep=arrrec.Geometry, Point=volume_3.Centroid, Strict=False)  # -> Inside, Index; disabled
cset = CreateSet(List=brepsinc.Index)  # -> Set, Map; disabled
sort = SortList(Keys=cset.Set, ValuesA=cset.Set)  # -> Keys, ValuesA; disabled
item_2 = ListItem(List=sort.ValuesA, Index=case, Wrap=True)  # disabled
mindex = MemberIndex(Set=brepsinc.Index, Member=item_2)  # -> Index, Count; disabled
item_3 = ListItem(List=geo_9, Index=mindex.Index, Wrap=True)  # disabled

arrbox = BoxArray(Geometry=box_2, Cell=box_2, XCount=round.Floor, YCount=round_3.Floor, ZCount=round_2.Floor)  # -> Geometry, Transform
bbox_2 = BoundingBox(Content=arrbox.Geometry, Plane=PlaneXY(0, 0, 0), UnionBox=True)  # -> Box, Box_2
volume_4 = Volume(Geometry=bbox_2.Box)  # -> Volume, Centroid
pdecon = Deconstruct(Point=volume_4.Centroid)  # -> XComponent, YComponent, ZComponent
inclusion_tolerance = Slider(0.5, range=0.01..0.99)
pt = ConstructPoint(XCoordinate=pdecon.XComponent, YCoordinate=pdecon.YComponent, ZCoordinate=0)
xy = XYPlane(Origin=pt)
brep = Brep(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)
brep_2 = Brep(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)
orient = Orient(
    Geometry=arrbox.Geometry,
    Source=xy,
    Target=Plane(origin=(15.75, 2.25, -2.41180409e-11), x=(1, 0, 0), y=(0, 1, 8.431737746e-12)))  # -> Geometry, Transform
remap = RemapNumbers(Value=inclusion_tolerance, Source=Domain(0.01, 0.99), Target=Domain(0.5, 0.99))  # -> Mapped, Clipped
volume_5 = Volume(Geometry=orient.Geometry)  # -> Volume, Centroid
subtraction = Subtraction(A=1, B=remap.Mapped)
scale = Scale(Geometry=orient.Geometry, Center=volume_5.Centroid, Factor=subtraction)  # -> Geometry, Transform
pdecon_2 = Deconstruct(Point=volume_5.Centroid)  # -> XComponent, YComponent, ZComponent
sort_2 = SortList(Keys=pdecon_2.ZComponent, ValuesA=pdecon_2.ZComponent)  # -> Keys, ValuesA
debrep = DeconstructBrep(Brep=scale.Geometry)  # -> Faces, Edges, simplify(Vertices)
cset_2 = CreateSet(List=sort_2.ValuesA)  # -> Set, Map
brepinc = PointInBrep(Brep=brep_2, Point=debrep.Vertices, Strict=False)
brepinc_2 = PointInBrep(Brep=brep, Point=debrep.Vertices, Strict=False)
item_4 = ListItem(List=cset_2.Set, Index=0, Wrap=True)
invbool = InvertBoolean(Boolean=brepinc)  # -> Inverted, Number
invbool_2 = InvertBoolean(Boolean=brepinc_2)  # -> Inverted, Number
mindex_2 = MemberIndex(Set=pdecon_2.ZComponent, Member=item_4)  # -> Index, Count
ma = MassAddition(Input=invbool.Number)  # -> Result, PartialResults
ma_2 = MassAddition(Input=invbool_2.Number)  # -> Result, PartialResults
item_5 = ListItem(List=orient.Geometry, Index=mindex_2.Index, Wrap=True)
cull = CullPattern(List=graft(orient.Geometry), CullPattern=invert(ma.Result))  # -> flatten(List)
cull_2 = CullPattern(List=graft(orient.Geometry), CullPattern=invert(ma_2.Result))  # -> flatten(List)

debrep_2 = DeconstructBrep(Brep=geo_8)  # -> Faces, Edges, Vertices
flatten = FlattenTree(Tree=debrep_2.Faces, Path="{0}")
flatten_2 = FlattenTree(Tree=debrep_2.Edges, Path="{0}")
flatten_3 = FlattenTree(Tree=debrep_2.Vertices, Path="{0}")
eval = EvaluateCurve(Curve=reparameterize(flatten_2), Parameter=0.5)  # -> Point, Tangent, Angle
area = Area(Geometry=flatten)  # -> Area, Centroid
cullpt = CullDuplicates(Points=flatten_3, Tolerance=0.1, CullMode=1)  # -> Points, Indices, Valence
cullpt_2 = CullDuplicates(Points=eval.Point, Tolerance=0.1, CullMode=1)  # -> Points, Indices, Valence
cullpt_3 = CullDuplicates(Points=area.Centroid, Tolerance=0.1, CullMode=1)  # -> Points, Indices, Valence
item_6 = ListItem(List=flatten_2, Index=cullpt_2.Indices, Wrap=True)
item_7 = ListItem(List=flatten, Index=cullpt_3.Indices, Wrap=True)

filter_2 = StreamFilter(Gate=list, Stream0=orient.Geometry, Stream1=item_5, Stream2=cull, Stream3=cull_2)
Z = UnitZ(Factor=1)
multiplication = Multiplication(A=item.Item2, B=100)
multiplication_2 = Multiplication(A=item.Item, B=100)
multiplication_3 = Multiplication(A=item.Item1, B=100)
concat = Concatenate(FragmentA="Number of actuator : ", FragmentB=actuator)
concat_2 = Concatenate(FragmentA="Seed : ", FragmentB=number_slider)
concat_3 = Concatenate(
    FragmentA="Dimensions (xyz) (cm) : ",
    FragmentB=multiplication_2,
    FragmentC=" x ",
    FragmentD=multiplication_3,
    FragmentE=" x ",
    FragmentF=multiplication)
swatch = ColourSwatch(SwatchColor=RGB(0, 0, 0))
swatch_2 = ColourSwatch(SwatchColor=RGB(255, 255, 255))
multiplication_4 = Multiplication(A="16", B=2)

line = Line(item_6)
srf = Surface(item_7)
pt_2 = Point(cullpt.Points)

evalsrf = EvaluateSurface(Surface=reparameterize(srf), Point="0.5,0.5")  # -> Point, Normal, UDirection, VDirection, Frame
curvepoint = PointOnCurve(line, parameter=0.5)
pdecon_3 = Deconstruct(Point=pt_2)  # -> XComponent, YComponent, ZComponent
pdecon_4 = Deconstruct(Point=evalsrf.Point)  # -> XComponent, YComponent, ZComponent
equalst = EqualityWithinTolerance(FirstNumber=pdecon_3.ZComponent, SecondNumber=0, Tolerance=0.001)  # -> Equality, Inequality
equalst_2 = EqualityWithinTolerance(FirstNumber=pdecon_4.ZComponent, SecondNumber=0, Tolerance=0.01)  # -> Equality, Inequality
pdecon_5 = Deconstruct(Point=curvepoint)  # -> XComponent, YComponent, ZComponent
cull_3 = CullPattern(List=pt_2, CullPattern=equalst.Inequality)
cull_4 = CullPattern(List=srf, CullPattern=equalst_2.Inequality)
equalst_3 = EqualityWithinTolerance(FirstNumber=pdecon_5.ZComponent, SecondNumber=0, Tolerance=0.001)  # -> Equality, Inequality
evalsrf_2 = EvaluateSurface(Surface=cull_4, Point="0.5,0.5")  # -> Point, Normal, UDirection, VDirection, Frame
cull_5 = CullPattern(List=line, CullPattern=equalst_3.Inequality)
devec = DeconstructVector(Vector=evalsrf_2.Normal)  # -> XComponent, YComponent, ZComponent
equals = Equality(FirstNumber=Z, SecondNumber=devec.ZComponent)  # -> Equality, Inequality
lng = ListLength(List=cull_5)
multiplication_5 = Multiplication(A=lng, B="0.3")
dispatch = Dispatch(List=cull_4, DispatchPattern=equals.Inequality)  # -> ListA, ListB
division_4 = Division(A=multiplication_5, B="0.7")
int = Integer(division_4)
previewlw = CustomPreviewLineweights(Geometry=cull_5, Shader=swatch, Thickness="0.02", Absolute=True)

lng_2 = ListLength(List=dispatch.ListA)
lng_3 = ListLength(List=cull_3)
msphere = MeshSphere(Base=cull_3, Radius="0.025", UCount=10, VCount=20)
lng_4 = ListLength(List=cull_5)

subtraction_2 = Subtraction(A=lng_2, B=int)
concat_4 = Concatenate(FragmentA="Number of nodes : ", FragmentB=lng_3)
previewmat = CustomPreviewMaterials(Geometry=msphere, DiffuseColor=swatch, Transparency=0)

reduce = RandomReduce(List=dispatch.ListA, Reduction=subtraction_2, Seed=number_slider)
debrep_3 = DeconstructBrep(Brep=reduce)  # -> simplify(flatten(Faces)), Edges, Vertices
explode = Explode(Curve=debrep_3.Faces, Recursive=True)  # -> Segments, Vertices
cull_i = CullIndex(List=explode.Vertices, Indices=-1, Wrap=True)  # -> simplify(List)
lng_5 = ListLength(List=debrep_3.Faces)
random = Random(Range=Domain(0, 1), Number=lng_5, Seed=number_slider)
round_4 = Round(Number=random)  # -> graft(Nearest), Floor, Ceiling

index = ItemIndex(List=dispatch.ListA, Item=reduce)
cull_i_2 = CullIndex(List=dispatch.ListA, Indices=index, Wrap=True)
lng_6 = ListLength(List=reduce)
srf_2 = Surface([dispatch.ListB, cull_i_2])
item_8 = ListItem(List=simplify(cull_i), Index=simplify(round_4.Nearest), Wrap=True)  # -> Item, Item1, Item2

ln = Line(StartPoint=item_8.Item, EndPoint=item_8.Item2)  # -> flatten(Line)
jitter = Jitter(List=ln, Jitter=1, Seed=2)  # -> Values, Indices
lng_7 = ListLength(List=jitter.Values)
multiplication_6 = Multiplication(A=lng_7)
split = SplitList(List=jitter.Values, Index=actuator)  # -> ListA, ListB
eval_2 = EvaluateCurve(Curve=reparameterize(split.ListA), Parameter=0.5)  # -> Point, Tangent, Angle
scale_2 = Scale(Geometry=split.ListA, Center=eval_2.Point, Factor=0.2)  # -> Geometry, Transform

addition_2 = Addition(A=lng_6, B=lng_4)
division_5 = Division(A=int, B=addition_2)
multiplication_7 = Multiplication(A=division_5, B=100)
int_2 = Integer(multiplication_7)
concat_5 = Concatenate(FragmentA="Number of all lines : ", FragmentB=addition_2)
concat_6 = Concatenate(FragmentA="Number of diagonals : ", FragmentB=lng_6, FragmentC=" (", FragmentD=int_2, FragmentE="%)")
merge = Merge(Data2=flatten(concat_5), Data3=flatten(concat_6), Data7=flatten(concat_4), Data8=flatten(concat_2))  # -> flatten(Result)
panel_4 = Panel(merge)
lng_8 = ListLength(List=merge)
series = Series(Start="100", Step=multiplication_4, Count=lng_8)
concat_7 = Concatenate(FragmentA="100", FragmentC=",", FragmentB=series)
previewlw_2 = CustomPreviewLineweights(Geometry=split.ListB, Shader=ColourSwatch(SwatchColor=RGB(255, 255, 0)), Thickness="3", Absolute=False)
previewlw_3 = CustomPreviewLineweights(Geometry=split.ListA, Shader=ColourSwatch(SwatchColor=RGB(230, 0, 86)), Thickness="3", Absolute=False)
previewmat_2 = CustomPreviewMaterials(Geometry=srf_2, DiffuseColor=ColourSwatch(SwatchColor=RGB(100, 100, 100)), Transparency=Slider(0.12, range=0..1))
previewlw_4 = CustomPreviewLineweights(Geometry=scale_2.Geometry, Shader=ColourSwatch(SwatchColor=RGB(0, 0, 255)), Thickness="7", Absolute=False)
texttoscreen = RenderTextToScreen(Text=merge, Location=concat_7, Size="16", Color=RGB(0, 0, 0), m_scWithvp=False)
geo_10 = Geometry([cull_5, msphere, srf_2])
